# Grasshopper definition hw02-gauge.gh (Grasshopper 1.0.7)

# ----
# Main Rectangle
big_rectangle_height = Slider(2.5, range=0..3)
big_rectangle_width = Slider(1.8, range=0..5)
rectangle = Rectangle(Plane=PlaneXY(0, 0, 0), XSize=big_rectangle_width, YSize=big_rectangle_height, Radius=0)  # -> Rectangle, Length

# ----
# The NOTCH in the upper-left
notch_size = Slider(0.3, range=0..1)
subtraction = Subtraction(A=big_rectangle_height, B=notch_size)
rectangle_2 = Rectangle(Plane=PlaneXY(0, 0, 0), XSize=notch_size, YSize=notch_size, Radius=0)  # -> Rectangle, Length
Y = UnitY(Factor=subtraction)
move = Move(Geometry=rectangle_2.Rectangle, Motion=Y)  # -> Geometry, Transform

# ----
# 2
# Caliper Slot right edge, in the middle
caliper_slot = Slider(0.203, range=0..1)
slot_depth = Slider(0.497, range=0..1)
_2 = Number(2)
division = Division(A=big_rectangle_height, B=_2)
rectangle_3 = Rectangle(Plane=PlaneXY(0, 0, 0), XSize=slot_depth, YSize=caliper_slot, Radius=0)  # -> Rectangle, Length
subtraction_2 = Subtraction(A=big_rectangle_width, B=slot_depth)
vec = VectorXYZ(XComponent=subtraction_2, YComponent=division, ZComponent=0)  # -> Vector, Length
move_2 = Move(Geometry=rectangle_3.Rectangle, Motion=vec.Vector)  # -> Geometry, Transform

slot_delta = Slider(0.25, range=0..1)
